# Grasshopper definition ICMLTableMaker.gh (Grasshopper 1.0.7)
# plug-ins: Redback, Python

charseq = CharSequence(Count=24, CharPool="ABCDEFGHIJKLMNOPQRSTUVWXYZ", Format="{0}")
partition = PartitionList(List=charseq, Size=4)
tstat = TreeStatistics(Tree=partition)  # -> Paths, Length, Count
lng = ListLength(List=tstat.Paths)
panel = Panel(partition)
charseq_2 = CharSequence(Count=lng, CharPool="ABCDEFGHIJKLMNOPQRSTUVWXYZ", Format="{0}")
long = LongestList(ListA=partition, ListB=graft(charseq_2), PaddingMode=2)  # -> ListA, graft(ListB)
graft = GraftTree(Tree=partition, IncludeEmptyLists=True, IncludeNullItems=True)
panel_2 = Panel("""value
class""")
merge = Merge(Data1=simplify(graft), Data2=simplify(long.ListB))
# {
#     "columnWidths": [20,12],
#     "variables": {"line-thick": 2, "line-medium": 1, "line-thin": 0.5 },
#     "css":
#     [	{"filters": [{"eval": "True", "searchType": "eval"} ], "style": {"paragraphStyle": "GH%3aTable - Small"} },
# 	{"filters": [{"eval": "bord['yPos'] in [1]", "searchType": "eval"} ], "style": {"weight":"{line-medium}"} },
# 	{"filters": [{"eval": "bord['yPosRev'] in [-3,-2]", "searchType": "eval"} ], "style": {"weight":"{line-medium}"} },
# 	{"filters":[{"searchType":"eval","eval":"'header' in ob['class']"}], "style":{"characterStyle":"Style%3aStyle\\%3a Bold", "hAlignment":"CenterAlign"}},
# 	{"filters":[{"searchType":"eval","eval":"'right' in ob['class']"}], "style":{"hAlignment":"RightAlign"}},
# 	{"filters":[{"searchType":"eval","eval":"'bold' in ob['class']"}], "style":{"characterStyle":"Style%3aStyle\\%3a Bold"}}
# ]
# }
panel_3 = Panel("""*{paragraphStyle:Table - Small;}
.A{characterStyle:Bold;}
bord{weight:1;}
[xPos=1]{weight:2;}""")
panel_4 = Panel("{\"columnWidths\": [7,14],\"columnWidthsRev\": [7], \"variables\": {\"line-thick\": 2, \"line-medium\": 1, \"line-thin\": 0.5 }}")
panel_5 = Panel("X:\93_Development\PackageManager\redback\components\testing")
json = CreateJSON(K=panel_2, V=merge)
json_2 = JSON(Key=panel_2, Value=merge)
path = FilePath("E:\mydev\redback\components\ICMLGenerator.py")
unflatten = UnflattenTree(Tree=json, Guide=partition)  # -> simplify(Tree)
panel_6 = Panel(path)
file = ReadFile(File=path, PerLineParse=False)
treetolist = GhPythonScript(Tree=unflatten)  # -> List; inputs Tree: tree
# ---------- treetolist: Python ----------
"""Converts Grasshopper Tree format to List format.
    Inputs:
        Tree: Tree to convert
    Output:
        List: Restructured data"""

from ghpythonlib.componentbase import executingcomponent as component
import Grasshopper, GhPython
import System
import Rhino
import rhinoscriptsyntax as rs

class MyComponent(component):
    
    def RunScript(self, Tree):
                        
        List = None
        __author__ = "danielle.bisazza"
        __version__ = "2022.06.30"
        import Grasshopper as gh
        import sys
        import json
                        
                        
        def TreeToPythonList(input, retrieve_base = lambda x: x[0]):
            """Returns a list representation of a Grasshopper DataTree"""
            def extend_at(path, index, simple_input, rest_list):
                #print("INPUT -- ", simple_input)
                #print("REST LIST ---", rest_list)
                target = path[index]
                #print("TARGET --", target)
                #print("INDEX  --", index)
                #try:
                    #simple_input = [int("%.2f") %num for num in list(simple_input)] #round ints to 2dec
                #except:
                    #simple_input = list(simple_input)
                sortList = []
                for value in list(simple_input):
                    #print("VALUE:  ", value, "TPYE:  ", type(value))
                    if type(value) == type(""):
                        try: 
                            value = json.loads(str(value))
                        except:
                            pass
                        sortList.append(value)
                        #print(value)
                    #### TO BE FIXED? - FLOATS ####
                    elif type(value) == type(0.0):
                        try:
                            value = "{:.2f}".format(value)
                            #print ("FLOAT", value)
                        except:
                            pass
                        sortList.append(value)
                    else:
                        sortList.append(value)
                                        
                #print(sortList)
                if len(rest_list) <= target: #make empty space for new value
                    #print("-MAKING NEW SPOT-", rest_list)
                    rest_list.extend([None]*(target-len(rest_list)+1))
                elif not (isinstance(i, list) for i in rest_list):
                    #print("EXTENDED LIST -- ", rest_list)
                    pass
                if index == path.Length - 1:
                    try:
                        if rest_list[target] != None: #if trying to replace value
                            #print(">><<<")
                            rest_list.insert(target, sortList)
                        else:
                            #print("replace", rest_list[target], sortList)
                            rest_list[target] = sortList
                            #print("new -- ", rest_list)
                    except:
                        rest_list[target] = sortList
                else:
                    if rest_list[target] is None: 
                        rest_list[target] = []
                    #print ("---- LOOOPPP ----", type(rest_list))
                    extend_at(path, index+1, sortList, rest_list[target])
            #print(input)
            all = []
            for i in range(input.BranchCount):
                #print(i)
                path = input.Path(i)
                print(path)
                extend_at(path, 0, input.Branch(path), all)
            if retrieve_base(all) < len(all):
                all = retrieve_base(all)
                #print(all)
            #print(retrieve_base(all))
            all = (all)
                            
            return all
                            
                        
        Tree = TreeToPythonList(Tree)
        print(Tree)
        writeList = json.dumps(Tree, ensure_ascii=False).decode('string_escape')
        List = writeList
                        
                
        
        # return outputs if you have them; here I try it for you:
        return List
# ---------- end treetolist ----------
icml = ICMLGenerator(D=treetolist, O=panel_4, C=panel_3)
rel_path = RelativePath(R="testing2.icml")  # -> FullPath, DirectoryPath, FileName
icml_2 = ICMLGenerator(D=treetolist, O=panel_4, C=panel_3)  # -> Log, Table
python = GhPythonScript(Code=file, D=treetolist, O=panel_4, C=panel_3)  # -> T, L
panel_7 = Panel("""1
2
3
4""")
panel_8 = Panel("""a
b
c
d""")
toggle = BooleanToggle(False)
rel_path_2 = PythonScript(D=toggle, R="Base\File.txt")  # -> FULL, FOLDER, FILE; inputs D: Boolean
# ---------- rel_path_2: Python ----------
import os
import Rhino
if D:
    DOC = Rhino.RhinoDoc.ActiveDoc.Path
else:
    DOC = str(ghenv.Component.Attributes.Owner.OnPingDocument().FilePath)

print(DOC)
docDir, docName = os.path.split(DOC)
docDirs = docDir.split(os.sep)
relDirs = R.split(os.sep)



for pathStep in relDirs:
    if pathStep == ".":
        del docDirs[-1]

relDirs = list(filter(lambda x: x != ".", relDirs))
newDirs = docDirs+relDirs
print(newDirs)
newDir = os.path.join(*newDirs)


FULL = newDir
FOLDER, FILE = os.path.split(newDir)
# ---------- end rel_path_2 ----------
panel_9 = Panel(python.L)
json_3 = CreateJSON(K=panel_8, V=panel_7)
rel_path_3 = RelativePath(D=toggle, R="Base\File.txt")  # -> FullPath, DirectoryPath, FileName
long_2 = LongestList(ListA=panel_8, ListB=json_3, PaddingMode=2)  # -> ListA, ListB
wrapper = TextWrapper(C=panel_8, W="\"")
panel_10 = Panel(rel_path_3.FullPath)
json_4 = CreateJSON(K=long_2.ListA, V=long_2.ListB)
path_2 = FilePath("K:\Computational Design Group\93_Development\PackageManager\redback\components\Wrapper.py")
file_2 = ReadFile(File=path_2, PerLineParse=False)
write = WriteFile(R=Toggle(True), C=icml, P=rel_path.DirectoryPath, N=rel_path.FileName)
read_json = ReadJSON(J=json_4, K="a.c")
json_keys = JSONKeys(MarshallingSignalParameter=json_4)
python_2 = GhPythonScript(Code=file_2, C=panel_8, W="\"")  # -> Out, W
panel_11 = Panel(write)
python_3 = GhPythonScript(Code=file_2, C=python_2.W, W="[", J=",")  # -> Out, W
rel_path_4 = RelativePath()  # -> FullPath, DirectoryPath, FileName
panel_12 = Panel(json_keys)
write_2 = WriteFile()
