# Grasshopper definition Install Redback.gh (Grasshopper 1.0.7)

python = GhPythonScript(RUN=Toggle(True))  # -> LOG
# ---------- python: Python ----------
from ghpythonlib.componentbase import executingcomponent as component
import Grasshopper, GhPython
import System
import Rhino
import rhinoscriptsyntax as rs


class MyComponent(component):
    def RunScript(self, RUN):
        """Provides a scripting component.
            Inputs:
                x: The x script variable
                y: The y script variable
            Output:
                a: The a output variable"""
        
        __author__ = "Andrew.Butler"
        __version__ = "2024.02.05"
        import rhinoscriptsyntax as rs
        import os
        LOG = []
        user = os.environ['USERPROFILE']
        customPackageManager = r"\\sydsrv01\Projects\Computational Design Group\93_Development\PackageManager"
        content = ""
        settingsLoc = r"{user}\AppData\Roaming\McNeel\Rhinoceros\7.0\settings\settings-Scheme__Default.xml".format(**{'user':user})
        with open(settingsLoc,"r") as file:
            content = file.read()
            if customPackageManager not in content:
                old = """</child>
    <child key="DockBarTabs" hidden="True">"""
                new = """<child key="PackageManager">
                <entry key="Sources">https://yak.rhino3d.com; %s</entry>
                </child>
    </child>
    <child key="DockBarTabs" hidden="True">"""%(customPackageManager)
                content = content.replace(old, new)
            else: print("already added")
        if content != "":
            with open(settingsLoc,"w") as file:
                file.write(content)
        
        rs.Command("-PackageManager S Redback")
        return LOG
# ---------- end python ----------
panel = Panel(python)
