# Grasshopper definition install.gh (Grasshopper 1.0.7)

python = GhPythonScript()  # -> LOG
# ---------- python: Python ----------
from ghpythonlib.componentbase import executingcomponent as component
import Grasshopper, GhPython
import System
import Rhino


class MyComponent(component):
    
    def RunScript(self, RUN):
        """Provides a scripting component.
            Inputs:
                x: The x script variable
                y: The y script variable
            Output:
                a: The a output variable"""
        
        __author__ = "Andrew.Butler"
        __version__ = "2024.02.05"
        import urllib
        import zip
        url = "https://codeload.github.com/sephbin/redback/zip/refs/tags/v0.0.1"
        
        
        urllib.urlretrieve(url, r'C:\Users\Andrew.Butler\AppData\Roaming\Redback\package.zip')
        LOG = ""
        # return outputs if you have them; here I try it for you:
        return LOG
# ---------- end python ----------
