# Grasshopper definition SVG Layout.gh (Grasshopper 1.0.8)
# plug-ins: RhinoCodePluginGH

xy = XYPlane(Origin=Point(0, 0, 0))
svg_layout = Python3Script(P=xy, D="A3 (L)", S="1:1", L=Toggle(False))  # -> L, R; inputs P: Plane
#   port P: Baseplane for page layout
#   port D: Page size or dimensions seperated by these delimeters: , x X * :
#   port S: Scale of the layout Either a single number or delimited by a colon (:)
#   port L: Location of the plane: True: Top Left False: Center
#   port L: Layout JSON object
#   port R: Rectangle representing the page boundary
# ---------- svg_layout: Python ----------
#### Constants ####
global __var__
__var__ = {
	"guid":"bb0530c2-d04f-4c52-8fb1-7f81d876a193",
	
	"name":"SVG Layout",
	"nickname":"SVG Layout",
	"description":"Creates a SVG layout dictionary",
	"icon": "ghContent\\Icon-SVGLayout.png",

	"tabname":"Redback",
	"section":"SVG",

	"inputs":[
		{"name":"Plane",		"nickname":"P",	"objectAccess":"item",	"description":"", },
		{"name":"Dimensions",	"nickname":"D",	"objectAccess":"item",	"description":"", },
		{"name":"Scale",		"nickname":"S",	"objectAccess":"item",	"description":"", },
		{"name":"Location",		"nickname":"L",	"objectAccess":"item",	"description":"", },
	],
	"outputs":[
		{"name":"Layout",		"nickname":"L",	"description":"JSON Layout"},
		{"name":"Rectangle",	"nickname":"R",	"description":"Page Border"},
	]
}
__author__ = "Andrew.Butler"
__version__ = "2024.02.02"
#### Constants ####

import json
import scriptcontext as sc
import rhinoscriptsyntax as rs
import Rhino



millimeters = sc.doc.ModelUnitSystem.Millimeters
currentUnits = sc.doc.ModelUnitSystem


#### This assumes base units as millimeters

unitRatio = Rhino.RhinoMath.UnitScale(millimeters, currentUnits)

pageLUT = {
"A5":		(210,148),
"A5 (L)":	(210,148),
"A5 (P)":	(148,210),
"A4":		(297,210),
"A4 (L)":	(297,210),
"A4 (P)":	(210,297),
"A3":		(420,297),
"A3 (L)":	(420,297),
"A3 (P)":	(297,420),
"A2":		(594,420),
"A2 (L)":	(594,420),
"A2 (P)":	(420,594),
"A1":		(841,594),
"A1 (L)":	(841,594),
"A1 (P)":	(594,841),
"A0":		(1189,841),
"A0 (L)":	(1189,841),
"A0 (P)":	(841,1189),
}

plane = P
location = L
scale = S

DIM = D
if not DIM:
	DIM = "A3 (L)"
if location == None:
	location = True
if scale == None:
	scale = "1:1"

pageScale = float(scale.split(":")[1])/float(scale.split(":")[0])

if DIM in pageLUT:
	width, height = pageLUT[DIM]
elif DIM.replace(",","").isdigit():
	width, height = tuple(DIM.split(","))


combScale = unitRatio*pageScale
swidth = float(width)*combScale
sheight = float(height)*combScale

print(width, height)


#print(dir(plane))
#print(plane.PointAt.__doc__)
print(location)
if location:
	positionedPlaneOrig = plane.PointAt(swidth/-2.0,sheight/-2.0,0)
	svgPlaneOrig = plane.PointAt(swidth/-2.0,sheight/2.0,0)
else:
	positionedPlaneOrig = plane.PointAt(0,-sheight,0)
	svgPlaneOrig = plane.PointAt(0,0,0)
print(positionedPlaneOrig)
plane.Origin = positionedPlaneOrig
#print(rs.AddRectangle.__doc__)
R = rs.AddRectangle(plane,swidth,sheight )
plane.Origin = svgPlaneOrig
p = plane

L = json.dumps({"plane":[[p.Origin[0],p.Origin[1],p.Origin[2]],[p.XAxis[0],p.XAxis[1],p.XAxis[2]],[p.YAxis[0],p.YAxis[1],p.YAxis[2]]], "page":[width,height], "scale":combScale})
# ---------- end svg_layout ----------
crv = Curve(svg_layout.R)
py3 = Python3Script(P=Toggle(False), R="testing\test.txt")  # -> F, D, N
# ---------- py3: Python ----------
#### Constants ####
global __var__
__var__ = {
	"guid":"41bdcdeb-7482-4608-873f-59490830db42",
	
	"name":"Relative Path",
	"nickname":"Rel Path",
	"description":"Creates a relative path to Rhino/GH document",
	"icon": "ghContent\\Icon-RelativePath.png",

	"tabname":"Redback",
	"section":"Files",

	"inputs":[
		{"name":"Path",		"nickname":"P",	"objectAccess":"item",	"description":"Path to append, or Boolean to choose current (F)Grasshopper or (T)Rhino document.", },
		{"name":"Relative Path",			"nickname":"R",	"objectAccess":"item",	"description":"Relative Path string", },
	],
	"outputs":[
		{"name":"Full path",		"nickname":"F",	"description":"Full Path"},
		{"name":"Directory path",	"nickname":"D",	"description":"Directory Path"},
		{"name":"File name",		"nickname":"N",	"description":"File name"},
	]
}
		
import os
import Rhino
import scriptcontext as sc

try:
	#print(P)
	if P == None:
		P = False
	#if not R:
	#	R = ""
	if type(P) == type(False): 
		if P:
			DOC = Rhino.RhinoDoc.ActiveDoc.Path
		else:
			DOC = sc.doc.Path
	else:
		DOC = P
	#print(DOC)
	if os.path.isdir(DOC):
		docDir = DOC
		docName = None
	else:
		docDir, docName = os.path.split(DOC)
	
	docDirs = docDir.split(os.sep)
	#print("1 docDirs",docDirs)
	if R == None:
		R = docName
	try:
		relDirs = R.split(os.sep)
	except:
		relDirs = []



	for pathStep in relDirs:
		#print("pathstep", pathStep)
		if pathStep == ".":
			del docDirs[-1]

	relDirs = list(filter(lambda x: x != ".", relDirs))
	#print("relDirs",relDirs)
	#print("docDirs",docDirs)
	newDirs = docDirs+relDirs
	#print("newDirs",newDirs)
	newDirs = list(map(lambda x: x.replace(":", ":"+os.sep), newDirs))
	newDir = os.path.join(*newDirs)

	#print(newDir)
	F = newDir
	if os.path.isdir(newDir):
		D = newDir
		N = None
	else:
		D, N = os.path.split(newDir)
except Exception as e:
	#print(e)
	F = R
	D, N = os.path.split(R)
# ---------- end py3 ----------
write_file = Python3Script(R=Toggle(True), C=svg_layout.L, P=py3.D, N=py3.N)  # -> F; inputs R: Boolean, C: list of String, P: String, N: String
# ---------- write_file: Python ----------
#### Constants ####
global __var__
__var__ = {
	"guid":"9bf0fbf6-1cb9-49e0-b0a0-0ced95dcf5f9",
	
	"name":"Write File",
	"nickname":"Write",
	"description":"Saves data to file",
	"icon": "ghContent\\Icon-WriteFile.png",

	"tabname":"Redback",
	"section":"Files",

	"inputs":[
		{"name":"Run",			"nickname":"R",	"objectAccess":"item",	"description":"", },
		{"name":"Content",		"nickname":"C",	"objectAccess":"list",	"description":"", },
		{"name":"Folder",		"nickname":"P",	"objectAccess":"item",	"description":"", },
		{"name":"Name",			"nickname":"N",	"objectAccess":"item",	"description":"", },
	],
	"outputs":[
		{"name":"Filepath",	"nickname":"F",	"description":"Absolute path to saved file"}
	]
}
__author__ = "Andrew.Butler"
__version__ = "2024.02.02"
#### Constants ####
        
import os
from json import dumps
def check(o):
    if str(type(o)) == "<type 'dict'>":
        return dumps(o)
    else:
        return o
F = None
if R:
    con = list(map(lambda u: check(u), C))
    conwrite = "\n".join(con)
    directory = P+"\\"+N
    fileDir, _t = os.path.split(directory)
    if not os.path.isdir(fileDir):
        os.makedirs(fileDir)
    F = directory
    with open(directory,'wb') as f:
        f.write(conwrite.encode("UTF-8"))
# ---------- end write_file ----------
